# Dynamo graph Ponte_Saber.dyn (Dynamo 3.3.0.6316)

# group: Marcação de um elemento estrutural tipo Mastro
# Autor: Prof. José Luis Menegotto
# Escola Politécnica da UFRJ
faz_a_marcação_do_mastro = CodeBlock()
# ---------- faz_a_marcação_do_mastro.designscript (10 lines) ----------
//------------------------------------------------------
//  Verificar que o material exista
//------------------------------------------------------
def Mastro(f,g,c)
{
    m = Material.ByName("Concreto");
    n = "Mastro";
    d = f?DirectShape.ByGeometry(g,c,m,n):0;
    return d;
};
# ----------------------------------------
faz_a_marcação_dos_cabos = CodeBlock()
# ---------- faz_a_marcação_dos_cabos.designscript (27 lines) ----------
//------------------------------------------------------
//  Harpa de estai
//------------------------------------------------------
def Estais( p , q , n)
{
    p1 = PolyCurve.Points( p )[7];
    p2 = PolyCurve.Points( q )[7];
    p3 = Point.Translate ( p1 , di*2 , 0 , 0 );
    p4 = Point.Translate ( p3 , di*5 , 0 , 0 );
//------------------------------------------------------
// Posicionamento do eixo dos cabos no mastro
//------------------------------------------------------
    ex  = Line.ByStartPointEndPoint ( p1 , p2 );
    di  = ex.Length / 2.4;
    ta  = ex.TangentAtParameter ( 0.0);
    pm  = ex.PointAtParameter   ( 0.5);
//------------------------------------------------------
// Posicionamento da Harpa
//------------------------------------------------------
    ha1 = Line.ByStartPointDirectionLength ( pm,ta,di);
    ha2 = Line.ByStartPointEndPoint        ( p3,p4   );
    ph1 = Line.PointAtParameter(ha1 , 0..1..#n);
    ph2 = Line.PointAtParameter(ha2 , 0..1..#n);
    est = Line.ByStartPointEndPoint( ph1 , ph2);

    return [ ha1, ha2 , ph1, ph2, est];
};
# ----------------------------------------
largura = DoubleSlider(3, range=1..8 step 0.25)
profundidade = DoubleSlider(1, range=1..5 step 0.25)
altura = DoubleSlider(26.5, range=3..30 step 0.25)
C1 = DoubleSlider(0.37, range=0.1..0.45 step 0.0025)
C2 = DoubleSlider(0.1475, range=0.1..0.45 step 0.0025)
simetria_x_1_simétrico = DoubleSlider(0.52, range=0.05..1 step 0.0025)
simetria_y_1_simétrico = DoubleSlider(0.6875, range=0.05..1 step 0.0025)
espessura_parede = DoubleSlider(0.05, range=0.05..0.5 step 0.05)
andar = Levels("Level 2")
seção_inferior_do_mastro = CodeBlock(l=largura, p=profundidade, h=altura, c1=C1, c2=C2, k=simetria_x_1_simétrico, j=simetria_y_1_simétrico, e=espessura_parede, and=andar)
# ---------- seção_inferior_do_mastro.designscript (26 lines) ----------
l;
p;
h;
m = 0.50;
c1;
c2;
k;
j;
e;
and;
par = "Elevation";
i  = [1,2,3,9,14,19,-2,-3,-4,15,10,5];
FamilyInstance.SetParameterByName(and, par, h);
//------------------------------------
x   = l * [ -m,-c1  ,0,c1*k,m ];
y   = p * [ -m,-c2*j,0,c2*j,m ];
//------------------------------------
LP  = Point.ByCoordinates (x<1>, y, 0);
LF  = List.Flatten ( LP , 1 );
LV  = LF[i];
Ex  = Line.ByBestFitThroughPoints(LV);
Pin = PolyCurve.ByPoints (LV, 1);
Pio = Pin.Offset(-e);
ke  = ["L","P","H","e","Pin","Pio"];
va  = [ l , p , h , e , Pin , Pio ];
Dic = Dictionary.ByKeysValues(ke, va);
# ----------------------------------------
escalar = DoubleSlider(0.5, range=0.2..1 step 0.05)
deslocamento = DoubleSlider(3.1, range=0..5 step 0.05)
categories = Categories("OST_BridgeAbutments")
modelar = BoolSelector(false)
quantidade_de_estai = DoubleSlider(20, range=5..20 step 1)
seção_superior_e_mastro = CodeBlock(Dic=seção_inferior_do_mastro.Dic, esc=escalar, des=deslocamento, cat=categories, mod=modelar, qes=quantidade_de_estai)
# ---------- seção_superior_e_mastro.designscript (19 lines) ----------
Dic;
esc;
des;
cat;
mod;
qes;
Pin = Dic["Pin"];
L   = Dic["L"  ];
H   = Dic["H"  ];
e   = Dic["e"  ];
m   = L * -des;
//------------------------------------
Psu = Geometry.Scale ( Pin  , esc  );
Ps2 = Psu.Translate  ( m , 0 , H   );
Po2 = Ps2.Offset     ( -e          );
sol = Solid.ByLoft   ( [Pin , Ps2] );
//------------------------------------
Mastro ( mod , sol , cat );
Estais ( Pin , Ps2 , qes );
# ----------------------------------------

# group: Marcação do tabuleiro
# Autor: Prof. José Luis Menegotto
# Escola Politécnica da UFRJ
largura_total_tabuleiro = DoubleSlider(10.25, range=10..15 step 0.25)
altura_do_tabuleiro = DoubleSlider(1.5, range=1.5..5 step 0.25)
espessura_do_tabuleiro = DoubleSlider(0.3, range=0.25..0.6 step 0.05)
seção_inferior_do_mastro_2 = CodeBlock(l=largura_total_tabuleiro, h=altura_do_tabuleiro, e=espessura_do_tabuleiro, pt=seção_superior_e_mastro.out16)
# ---------- seção_inferior_do_mastro_2.designscript (19 lines) ----------
l;
h;
e;
pt;
f  =  0.050;
a  =  0.500;
m  =  0.500;
i  = [1,2,7,11,15,18,17,12,8,4];
//------------------------------------
y  = l * [ -m,     -f,   0    ,f   , m ];
z  = h * [  0, -0.1*a, -0.8*a , -2*a   ];
//------------------------------------
LP  = Point.ByCoordinates (0, y<1>, z);
LF  = List.Flatten ( LP , 1 );
LV  = LF[i];
TB  = PolyCurve.ByPoints(LV, 1);
TI  = TB.Offset(-e);
ET  = Line.ByStartPointEndPoint(LV[3], LV[8]);
TA  = Geometry.Translate(TB, Point.AsVector(pt[3]));
# ----------------------------------------
