# Dynamo graph Paraboloide_Midi.dyn (Dynamo 2.17.1.4055)

zero = TimeSpan.Zero()
now = DateTime.Now()
timeOfDay = DateTime.TimeOfDay(dateTime=now)
add = TimeSpan.Add(timeSpan1=zero, timeSpan2=timeOfDay)
revit_uia = Python(IN[0]=add)  # CPython3
# ---------- revit_uia.python (20 lines) ----------
import clr
import Revit

clr.AddReference("ProtoGeometry")
clr.AddReference("RevitAPI")
clr.AddReference("RevitAPIUI")
clr.AddReference("RevitServices")
clr.AddReference("RevitNodes")

from Autodesk.DesignScript.Geometry import *
from Autodesk.Revit.DB import *
from RevitServices.Persistence import DocumentManager


dad = IN[0]

doc = DocumentManager.Instance.CurrentDBDocument
uia = DocumentManager.Instance.CurrentUIApplication

OUT = uia
# ----------------------------------------
code_block = CodeBlock { 0; }
MIDI_Ativar = Musica_2020.Musica_2020.MIDI_Ativar(n=code_block)
toca_0_ou_1 = IntegerSlider(1, range=0..1 step 1)
instrumentos_1_a_128 = IntegerSlider(11, range=0..128 step 1)
toca_paraboloide = CodeBlock(rvuia=revit_uia, tempo=add, midi=MIDI_Ativar, toca=toca_0_ou_1, inst=instrumentos_1_a_128)
# ---------- toca_paraboloide.designscript (51 lines) ----------
rvuia;
tempo;
midi;
toca;
inst;
//---------------------------------------------------------
// Converte em string o Tempo Atual e separa segs e mils
// Configurar o período compatível com a duração
//---------------------------------------------------------
min  = 10;
mili = String.Substring ( tempo+"" , 9 , 3);
s    = (String.ToNumber ( mili ) % min )+min;
x    = (0..s);
y    = (0..s);
z1   = (0..s);
z2   = (s..0) * (s%1? s*1.1 : s/min);
pt   = Point.ByCoordinates ( x<1> , y , 0);
i    = 0..s-1;
j    = i+1;
p1   = pt[ 0].Translate    ( 0 , 0 , z1);
p2   = pt[-1].Translate    ( 0 , 0 , z2);
pp   = Line.DivideEqually  ( g1  ,  s).StartPoint;

g1   = Line.ByStartPointEndPoint ( p1    , p2);
g2   = Line.ByStartPointEndPoint ( p1[i] , p1[j]);
g3   = Line.ByStartPointEndPoint ( p2[i] , p2[j]);
g4   = Line.ByStartPointEndPoint ( pp[i] , pp[j]);

pts  = List.Flatten([p1, p2, pp] , 2);
e    = [ 0, 1, 0, 2, 0, 3 ,  4, 0 , -7, 0, -8, -10, -9 , 0];
d    = [ 1, 1, 1, 1, 1, 1 ,  1, 1 ,  1, 1,  1,   1,  1 , 1];
//Esfe = Musica_2020.Obj_Esfera( rvuia );
//---------------------------------------------------------
// Se aumentar a dur deve aumentar o período para que possa
// completar o ciclo
//---------------------------------------------------------
esc = List.ShiftIndices( e , s%3? 1 : s%2? 2 : 3 );
div = List.ShiftIndices( d , s%3? 1 : s%2? 2 : 3 );
n   = List.Count(esc)-1;
alt = Math.Floor( pts.Z )%n;
tem = Math.Floor( pts.Z )%n;
fun = s%3?60:66;

sal = esc[alt];
dur = Math.Floor ((min * 900) / (Math.Pow( s+1 , 1.5) * div[alt]));
din = 127;

//---------------------------------------------------------
// Tocar --------------------------------------------------
//---------------------------------------------------------
Musica_2020.Tocar_Nota( midi, fun, sal, dur, din, 1, 9, toca);
# ----------------------------------------
dia = Watch(toca_paraboloide.s)
S = Watch(toca_paraboloide.e)
watch = Watch()  # unwired: arg0
